# Grasshopper definition Building_Hops_Output.gh (Grasshopper 1.0.7)
# plug-ins: Hops

hops = Hops(
    Length=Slider(9, range=5..25),
    Width=Slider(18, range=5..25),
    Room_Height=Slider(2.5, range=2.5..3),
    No_of_Floors=Slider(20, range=1..20),
    Floor_Thickness=Slider(0.3, range=0.1..0.3),
    CacheResultsInMemory=True,
    CacheSolveResults=True,
    RemoteDefinitionLocation="D:\Acadamic\MaCAD\Module_02\S3 - Digital tools for Cloud-based Data Management\Assignments\bimsc24-datamgmt-session01\Assignment01\Building_Hops.gh",
    RemoteSolveVersion=(0, 1, 0),
    ShowInput_Enabled=False,
    ShowInput_Path=False,
    SynchronousSolve=True)
